# Grasshopper definition script.gh (Grasshopper 1.0.7)

# ----
# Inputs from Rhino Compute
number_slider = Slider(21, range=1..31)
# Tower Parameters
# Floor Plan length
# Twist End
floorplan_width = GetInteger(Slider(15, range=10..18), AtLeast=1, AtMost=1, Maximum=2147483647, Minimum=-2147483648, TreeAccess=False)
twist_top = GetNumber(Slider(0.74, range=0.2..1), AtLeast=1, AtMost=1, Maximum=1.797693135e+308, Minimum=-1.797693135e+308, TreeAccess=False)
day = GetInteger(number_slider, AtLeast=1, AtMost=1, Maximum=2147483647, Minimum=-2147483648, TreeAccess=False)
tower_height = GetInteger(Slider(72, range=20..100), AtLeast=1, AtMost=1, Maximum=2147483647, Minimum=-2147483648, TreeAccess=False)
# Floor Height
# Tower Height
floor_height = GetNumber(Slider(3.7, range=2.5..5), AtLeast=1, AtMost=1, Maximum=1.797693135e+308, Minimum=-1.797693135e+308, TreeAccess=False)
# Rotation Angle
rotation = GetInteger(Slider(52, range=0..90), AtLeast=1, AtMost=1, Maximum=2147483647, Minimum=-2147483648, TreeAccess=False)
month = GetInteger(Slider(6, range=1..12), AtLeast=1, AtMost=1, Maximum=2147483647, Minimum=-2147483648, TreeAccess=False)

# ----
# Analysis Period for
# Summer Solstice
number_slider_2 = Slider(6, range=0..10)
analysisperiod = LBAnalysisPeriod(
    start_month=month,
    start_day=day,
    start_hour=number_slider_2,
    end_month=month,
    end_day=day,
    end_hour=Slider(18, range=0..100),
    timestep="1")  # -> period, hoys, dates; plug-in component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

# ----
# Import Location from EPW File
panel = Panel("https://energyplus-weather.s3.amazonaws.com/europe_wmo_region_6/NLD/NLD_Amsterdam.062400_IWEC/NLD_Amsterdam.062400_IWEC.zip")
downloadepw = LBDownloadWeather(weather_URL=panel)  # -> epw_file, stat_file, ddy_file; plug-in component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
downloadepw_2 = LBDownloadWeather(weather_URL=panel)  # -> epw_file, stat_file, ddy_file; plug-in component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
importepw = LBImportEPW(epw_file=downloadepw.epw_file)  # -> location, dry_bulb_temperature, dew_point_temperature, relative_humidity, wind_speed, wind_direction, direct_normal_rad, diffuse_horizontal_rad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; plug-in component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
importloc = LBImportLocation(epw_file=downloadepw_2.epw_file)  # -> location; plug-in component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

# ----
# Create tower
# Total Gross Area
# Floor Area
dom = ConstructDomain(DomainStart=expr("-0.5*x", floorplan_width), DomainEnd=expr("0.5*x", floorplan_width))
radians = Radians(Degrees=rotation)
rectangle = Rectangle(Plane=PlaneXY(0, 0, 0), XSize=dom, YSize=dom, Radius=0)  # -> Rectangle, Length
box_rectangle = BoxRectangle(Rectangle=rectangle.Rectangle, Height=tower_height)
multiplication = Multiplication(A=twist_top, B=tower_height)
unit_z = UnitZ(Factor=multiplication)
area = Area(Geometry=rectangle.Rectangle)  # -> Area, Centroid
move = Move(Geometry=area.Centroid, Motion=unit_z)  # -> Geometry, Transform
line = Line(StartPoint=area.Centroid, EndPoint=move.Geometry)
division = Division(A=tower_height, B=floor_height)
twist = Twist(Geometry=box_rectangle, Axis=line, Angle=radians, Infinite=False, Rigid=False)
round = Round(Number=division)  # -> Nearest, Floor, Ceiling
panel_2 = Panel(area.Area)
multiplication_2 = Multiplication(A=panel_2, B=round.Floor)
panel_3 = Panel(multiplication_2)
floor_area = Integer(area.Area)
gross_area = Integer(multiplication_2)

# ----
# Create Sunpath
number_slider_3 = Slider(1, range=0..10)
sunpath = LBSunPath(north="20", location=importloc, hoys=analysisperiod.hoys, scale=number_slider_3, data=importepw.dry_bulb_temperature)  # -> report, vectors, altitudes, azimuths, hoys, sun_pts, analemma, daily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; plug-in component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

# ---- group: Run Me!
# Run Analysis
boolean_toggle = BooleanToggle(True)

# ----
area_2 = Area(Geometry=twist)  # -> Area, Centroid
facade_area = Integer(area_2.Area)
context_print = ContextPrint(Facade_area=facade_area)

# ----
# Run Direct Sun Study
# Analysis mesh
brep = Brep(twist)
context = Brep(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)
tri = Triangulate(Mesh=brep)  # -> Mesh, Count
directsunhours = LBDirectSunHours(
    vectors=flatten(sunpath.vectors),
    timestep="1",
    geometry=graft([context, tri.Mesh]),
    context=flatten([context, tri.Mesh]),
    grid_size="5",
    offset_dist="0.1",
    run=boolean_toggle)  # -> report, points, results, mesh, legend, title, int_mtx; plug-in component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

avr = Average(Input=directsunhours.results)
mjoin = MeshJoin(Meshes=flatten(directsunhours.mesh))

branch = TreeBranch(Tree=simplify(avr), Path="{0}", MaintainPaths=False)
branch_2 = TreeBranch(Tree=simplify(avr), Path="{1}", MaintainPaths=False)
rotate = Rotate(Geometry=mjoin, Angle=1.570796327, Plane=PlaneXY(0, 0, 0))  # -> Geometry, Transform
avg_sun_hours_context = Number(branch)
avg_sun_hours_tower = Number(branch_2)
mesh = Mesh(flatten(rotate.Geometry))

context_print_2 = ContextPrint(Avg_sun_hours_context=avg_sun_hours_context)
context_print_3 = ContextPrint(Avg_sun_hours_tower=avg_sun_hours_tower)

# ----
# Outputs to Rhino Compute
context_print_4 = ContextPrint(Gross_area=gross_area)
context_print_5 = ContextPrint(Floor_area=floor_area)
context_bake = ContextBake(Geometry=mesh)
